# Grasshopper definition 05_Nozzles.gh (Grasshopper 1.0.7)
# plug-ins: Salad Slicer

# ----
# License and author information
I = Info()
panel = Panel(I)

recnozty1 = RectangularNozzleType1(
    BoxWidth=Slider(70, range=0..100),
    BoxDept=Slider(50, range=0..100),
    FilletRadius=Slider(10, range=0..20),
    Length1=Slider(25, range=0..100),
    Length2=Slider(75, range=0..100),
    Length3=Slider(25, range=0..100),
    Length4=Slider(25, range=0..100),
    OuterDiameter=Slider(30, range=0..100),
    InnerDiameter=Slider(27, range=0..100),
    NozzleWidth=Slider(50, range=0..100),
    NozzleHeight=Slider(10, range=0..100),
    Divide=Toggle(True))
recnozty1_2 = RectangularNozzleType2(
    Length1=Slider(25, range=0..100),
    Length2=Slider(75, range=0..100),
    Length3=Slider(25, range=0..100),
    Length4=Slider(25, range=0..100),
    OuterDiameter=Slider(30, range=0..100),
    InnerDiameter=Slider(27, range=0..100),
    NozzleWidth=Slider(50, range=0..100),
    NozzleHeight=Slider(10, range=0..100),
    WallThickness=Slider(4, range=0..10),
    Gap=Slider(1, range=0..10))
rounoz = RoundNozzle(
    Length1=Slider(25, range=0..100),
    Length2=Slider(100, range=0..100),
    Length3=Slider(25, range=0..100),
    OuterDiameter=Slider(41, range=0..100),
    InnerDiameter=Slider(35, range=0..100),
    NozzleDiameter=Slider(30, range=0..100),
    WallThickness=Slider(4, range=0..10),
    Gap=Slider(1, range=0..10))
X = UnitX(Factor=Slider(300, range=0..1000))
X_2 = UnitX(Factor=Slider(150, range=0..1000))
preview = CustomPreview(Geometry=rounoz, Material=ColourSwatch(SwatchColor=RGB(168, 168, 168)))
move = Move(Geometry=recnozty1, Motion=X)  # -> Geometry, Transform
move_2 = Move(Geometry=recnozty1_2, Motion=X_2)  # -> Geometry, Transform
preview_2 = CustomPreview(Geometry=move.Geometry, Material=ColourSwatch(SwatchColor=RGB(168, 168, 168)))
preview_3 = CustomPreview(Geometry=move_2.Geometry, Material=ColourSwatch(SwatchColor=RGB(168, 168, 168)))
